# Grasshopper definition slicingShape_final.gh (Grasshopper 0.9.62)

scale = Slider(1.2, range=1..10)
scale_2 = Slider(1, range=1..3)
X = Slider(18, range=1..18)
timer = Timer(TimerInterval=1, Target=udp)  # disabled
Y = Slider(1, range=0..10)
Z = Slider(7, range=0..10)
tolerance = Slider(1e-05, range=0..1)
time = Slider(1.86, range=0..10)
proportion = Slider(0.3, range=0..1)
scale_3 = Slider(1, range=1..3)
reset = BooleanToggle(True)
brep = Brep()
not = GateNot(A=reset)
fogmatrix = CSharpScript(
    srf=brep,
    divX=X,
    divY=Y,
    divZ=Z,
    tolerance=tolerance,
    time=time,
    proportion=proportion,
    scal_x=scale_3,
    scal_y=scale_2,
    scal_z=scale)  # -> out, bbox, bboxPoints, arrPoints, arrBoxes, testIntersection, volume, outPoints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; inputs srf: Brep, divX: Int32, divY: Int32, divZ: Int32, tolerance: Double, time: Double, proportion: Double, scal_x: Double, scal_y: Double, scal_z: Double
# ---------- fogmatrix: C# ----------
    //initialize array for storing bbox corner points
    outBboxPoints = new Point3d[8];
    //initialize array for storing div points
    outArrPoints = new Point3d[divX, divY, divZ];
    //initialize array for storing box
    outArrBox = new Box[divX, divY, divZ];
    //initialize array for storing intersection
    //outIntersection = new Brep[divX * divY * divZ];
    //temBoxes = new Brep[divX * divY * divZ];

    //get BBox from object
    Box outBox;
    srf.GetBoundingBox(Plane.WorldXY, out outBox);

    //slightly scale up the BBox
    Transform scale = Transform.Scale(new Plane(new Point3d(outBox.Center.X, outBox.Center.Y, outBox.Center.Z), new Vector3d(0, 1, 0))
      , scal_x, scal_y, scal_z);
    outBox.Transform(scale);

    //store points to arrat
    outBboxPoints = outBox.GetCorners();
    outBBoxCenter = outBox.Center;


    double domainX = Math.Abs(outBboxPoints[1].X - outBboxPoints[0].X);
    //Print("domainX = " + domainX);
    double domainY = Math.Abs(outBboxPoints[3].Y - outBboxPoints[0].Y);
    //Print("domainY = " + domainY);
    double domainZ = Math.Abs(outBboxPoints[4].Z - outBboxPoints[0].Z);
    //Print("domainZ = " + domainZ);

    double distanceX = domainX / divX;
    //Print("distanceX = " + distanceX);
    double distanceY = domainY / divY;
    //Print("distanceY = " + distanceY);
    double distanceZ = domainZ / divZ;
    //Print("distanceZ = " + distanceZ);

    //get first center point for creating box
    double centerFirstPt_X = distanceX / 2;
    //Print("centerFirstPt_X = " + centerFirstPt_X);
    double centerFirstPt_Y = distanceY / 2;
    //Print("centerFirstPt_Y = " + centerFirstPt_Y);
    double centerFirstPt_Z = distanceZ / 2;
    //Print("centerFirstPt_Z = " + centerFirstPt_Z);

    bbox = outBox;
    bboxPoints = outBboxPoints;

    //get first point
    Point3d firstPoint = new Point3d(centerFirstPt_X + outBboxPoints[0].X,
      centerFirstPt_Y + outBboxPoints[0].Y, centerFirstPt_Z + outBboxPoints[0].Z);
    /*
    cornerPt_00 = outBboxPoints[0];
    cornerPt_01 = outBboxPoints[1];
    cornerPt_02 = outBboxPoints[2];
    cornerPt_03 = outBboxPoints[3];
    cornerPt_04 = outBboxPoints[4];
    cornerPt_05 = outBboxPoints[5];
    cornerPt_06 = outBboxPoints[6];
    cornerPt_07 = outBboxPoints[7];
    */
    //store all bbox points in array
    int i = 0;
    int j = 0;
    int k = 0;
    for(double x = firstPoint.X; x < outBboxPoints[1].X; x = x + distanceX){
      for(double y = firstPoint.Y; y < outBboxPoints[3].Y; y = y + distanceY){
        for(double z = firstPoint.Z; z < outBboxPoints[4].Z; z = z + distanceZ){

          if( k == divZ){
            k = 0;
            j++;
          }
          if( j == divY){
            j = 0;
            i++;
          }

          Point3d getPts = new Point3d(x, y, z);
          outArrPoints[i, j, k] = getPts;
          //Print("[" + i + "]" + "[" + j + "]" + "[" + k + "]" + "=" + getPts);
          //Box getBox = new Box(new Plane(getBox, new Vector3d(0, 0, 1)), new Interval(-centerFirstPt_X, centerFirstPt_X),
          //new Interval(-centerFirstPt_Y, centerFirstPt_Y), new Interval(-centerFirstPt_Z, centerFirstPt_Z));
          Box getBox = new Box(new Plane(getPts, new Vector3d(0, 0, 1)), new Interval(-centerFirstPt_X, centerFirstPt_X),
            new Interval(-centerFirstPt_Y, centerFirstPt_Y), new Interval(-centerFirstPt_Z, centerFirstPt_Z));

          outArrBox[i, j, k] = getBox;
          k++;
        }
      }
    }

    arrPoints = outArrPoints;
    arrBoxes = outArrBox;
    outIntersection = new List<Brep>();
    arrShapeVolume = new List<double>();
    displayShape = new List<shape>();
    arrFinalPoints = new List<Point3d>();
    arrOnOff = new List<int>();
    arrOnPoints = new List<Point3d>();
    arrOffPoints = new List<Point3d>();
    arrOnBoxes = new List<Box>();
    arrTime = new List<double>();

    for(int a = 0; a < divX; a++){
      for(int b = 0; b < divY; b++){
        for(int c = 0; c < divZ; c++){

          brepIntersect = Brep.CreateBooleanIntersection(outArrBox[a, b, c].ToBrep(), srf, tolerance);
          VolumeMassProperties boxVolume = VolumeMassProperties.Compute(outArrBox[a, b, c].ToBrep());

          Print("interLength=" + brepIntersect.Length);

          double totalSubVolume = 0;
          int countSubVoulme = 0;
          shape arrShape;

          //check if there is no intersection then set it to "0" volume
          if(brepIntersect == null || brepIntersect.Length == 0){

            arrShapeVolume.Add(0.0);
            arrShape = new shape(new Point3d(outArrBox[a, b, c].Center.X, outArrBox[a, b, c].Center.Y, outArrBox[a, b, c].Center.Z)
              , 48, time / divZ);
            displayShape.Add(arrShape);
            arrOffPoints.Add(new Point3d(outArrBox[a, b, c].Center.X, outArrBox[a, b, c].Center.Y, outArrBox[a, b, c].Center.Z));

          }else if(brepIntersect != null){
            foreach(Brep tempIntersection in brepIntersect){

              outIntersection.Add(tempIntersection);
              VolumeMassProperties shapeVolume = VolumeMassProperties.Compute(tempIntersection);

              //checking if there is more than one piece in subSurface
              //if > 1 and then sum them up and store it in List arrShapeVolume
              //if == 1 then store it directly in List arrShapeVolume
              if(brepIntersect.Length > 1){

                if(countSubVoulme == brepIntersect.Length - 1){

                  arrShapeVolume.Add(totalSubVolume);
                  arrShape = new shape(new Point3d(outArrBox[a, b, c].Center.X, outArrBox[a, b, c].Center.Y, outArrBox[a, b, c].Center.Z)
                    , 48, time / divZ);
                  displayShape.Add(arrShape);
                  arrOffPoints.Add(new Point3d(outArrBox[a, b, c].Center.X, outArrBox[a, b, c].Center.Y, outArrBox[a, b, c].Center.Z));

                }
                countSubVoulme++;

              }else if(brepIntersect.Length == 1){

                //cal the volume if volume > proportion and then set the value to 1 else 0
                //set in class shape and store in List displayShape
                double calVolume = shapeVolume.Volume / boxVolume.Volume;
                if(calVolume >= proportion){

                  arrShape = new shape(new Point3d(outArrBox[a, b, c].Center.X, outArrBox[a, b, c].Center.Y, outArrBox[a, b, c].Center.Z)
                    , 49, time / divZ);
                  //Print("position=" + new Point3d(outArrBox[a, b, c].Center.X, outArrBox[a, b, c].Center.Y, outArrBox[a, b, c].Center.Z));
                  displayShape.Add(arrShape);
                  arrOnPoints.Add(new Point3d(outArrBox[a, b, c].Center.X, outArrBox[a, b, c].Center.Y, outArrBox[a, b, c].Center.Z));
                  arrOnBoxes.Add(outArrBox[a, b, c]);

                }else{

                  arrShape = new shape(new Point3d(outArrBox[a, b, c].Center.X, outArrBox[a, b, c].Center.Y, outArrBox[a, b, c].Center.Z)
                    , 48, time / divZ);
                  displayShape.Add(arrShape);
                  //Print("position=" + new Point3d(outArrBox[a, b, c].Center.X, outArrBox[a, b, c].Center.Y, outArrBox[a, b, c].Center.Z));
                  arrOffPoints.Add(new Point3d(outArrBox[a, b, c].Center.X, outArrBox[a, b, c].Center.Y, outArrBox[a, b, c].Center.Z));
                }
                arrShapeVolume.Add(shapeVolume.Volume);

              }
            }
          }

        }
      }
    }

    for(int s = 0; s < displayShape.Count; s++){

      shape getShape = displayShape[s] as shape;
      Point3d getShapePoints = getShape.getPosition();
      arrFinalPoints.Add(getShapePoints);
      arrOnOff.Add(getShape.getDisplay());
      arrTime.Add(getShape.getTime());
    }

    testIntersection = outIntersection;
    volume = arrShapeVolume;
    outPoints = arrFinalPoints;
    outOnOff = arrOnOff;
    outOnPoints = arrOnPoints;
    outOffPoints = arrOffPoints;
    outOnBoxes = arrOnBoxes;
    outTime = arrTime;
# ---------- fogmatrix: C# additional code ----------
  Point3d[] outBboxPoints;
  Point3d[,,] outArrPoints;
  Box[,,] outArrBox;
  Brep[] brepIntersect = null;
  List<Brep> outIntersection;
  List<double> arrShapeVolume;
  List<shape> displayShape;
  List<Point3d> arrFinalPoints;
  List<int> arrOnOff;
  List<Point3d> arrOnPoints;
  List<Point3d> arrOffPoints;
  List<Box> arrOnBoxes;
  List<double> arrTime;

  class shape{

    Point3d pointcloud;
    int display;
    double time;

    public shape(Point3d pointcloud, int display, double time){

      this.pointcloud = pointcloud;
      this.display = display;
      this.time = time;
    }

    public Point3d getPosition(){

      return pointcloud;
    }

    public int getDisplay(){

      return display;
    }

    public double getTime(){

      return time;
    }
  }
# ---------- end fogmatrix ----------
panel = Panel(fogmatrix.out)
box = Box(fogmatrix.arrBoxes)
pt = Point(fogmatrix.outOnPoints)
box_2 = Box(fogmatrix.bbox)
pt_2 = Point(fogmatrix.bboxPoints)
brep_2 = Brep(fogmatrix.testIntersection)
pt_3 = Point(fogmatrix.outOffPoints)
box_3 = Box(fogmatrix.outOnBoxes)
pt_4 = Point(fogmatrix.arrPoints)
panel_2 = Panel(fogmatrix.outOnOff)
panel_3 = Panel(fogmatrix.outTime)
pt_5 = Point(fogmatrix.outPoints)

z = Series(Start=0, Step=1, Count=Z)
multiplication = Multiplication(A=X, B=Y)
y = Series(Start=0, Step=1, Count=Y)
series = Series(Start=z, Step=Z, Count=multiplication)
series_2 = Series(Start=y, Step=Y, Count=X)  # -> flatten(Series)
item = ListItem(List=pt_5, Index=series, Wrap=True)
item_2 = ListItem(List=item, Index=series_2, Wrap=True)  # -> flatten(Item)

panel_4 = Panel(z)
panel_5 = Panel(pt_5)
panel_6 = Panel(y)

multiplication_2 = Multiplication(A=X, B=Y)
series_3 = Series(Start=0, Step=1, Count=Z)
series_4 = Series(Start=0, Step=1, Count=Y)
series_5 = Series(Start=series_4, Step=Y, Count=X)  # -> flatten(Series)
series_6 = Series(Start=series_3, Step=Z, Count=multiplication_2)
item_3 = ListItem(List=fogmatrix.outOnOff, Index=series_6, Wrap=True)
item_4 = ListItem(List=item_3, Index=series_5, Wrap=True)  # -> flatten(Item)

panel_7 = Panel(item_4)
udp = CSharpScript(port="6002", Start=not, Points=item_2, onORoff=item_4, time=panel_3, bboxCenterPoint=fogmatrix.outBBoxCenter)  # -> out, Msg; inputs port: Int32, Start: Boolean, Points: list of Point3d, onORoff: list of Int32, time: list of Double, bboxCenterPoint: Point3d
# ---------- udp: C# ----------
    if(!Start){
      port = -1;
      Points = new List<Point3d>();
      onORoff = new List<int>();
      time = new List<double>();
    }

    //If we already had started receiving
    if(begunReceiving) {

      if(messageReceived) {
        //We set that message was collected
        messageReceived = false;
        count++;
        Print("Value is updated...");
      }else {
        Print("Loop with no updates...");
        try {

          string outData = "";
          for(int i = 0; i < Points.Count; i++){
            for(int j = 0; j < onORoff.Count; j++){
              for(int k = 0; k < time.Count; k++){

                if(i == j && i == k && j == k) outData += (Points[i] + "," + onORoff[j] + "," + time[k] + "," + bboxCenterPoint + "|");
              }
            }
          }
          System.Net.IPEndPoint ip = new System.Net.IPEndPoint(System.Net.IPAddress.Loopback, 6001);
          udpClient.Send(System.Text.Encoding.ASCII.GetBytes(outData), System.Text.Encoding.ASCII.GetByteCount(outData), ip);
          Print("UdpSender sent: " + outData);

        } catch(System.Net.Sockets.SocketException ex){
          Print("UdpSender Error sending: " + ex.ErrorCode);
        } catch(Exception ex){
          Print("UdpSender Error sending: " + ex.Message);
        }
      }

      if(port != listenPort){
        if(port == -1){
          StopReceiving();
          listenPort = port;

        }else{

          StopReceiving();
          if(ReceiveMessages(port)){
            listenPort = port;
          }
        }
        count = 0;
      }
    }else{
      //Otherwise we need to start receiving...
      Print(" else");
      if(port > 0){
        listenPort = port;
        ReceiveMessages(port);
      }else{
        Print("Waiting for a port to listen to...");
      }
    }
# ---------- udp: C# additional code ----------
  //Code example from http://msdn.microsoft.com/en-us/library/system.net.sockets.udpclient.beginreceive.aspx
  private System.Net.Sockets.UdpClient udpClient = null;
  private System.Net.IPEndPoint ip;
  int count = 0;

  private int listenPort = 0;
  private static bool begunReceiving = false;
  private volatile bool messageReceived = false;
  private volatile string messageText = null;



  private void ReceiveCallback(IAsyncResult ar) {
    try {
      if(udpClient != null){
        Byte[] receiveBytes = udpClient.EndReceive(ar, ref ip);
        messageText = System.Text.Encoding.ASCII.GetString(receiveBytes);
        messageReceived = true;
        Print("Received " + messageText);

        udpClient.BeginReceive(new AsyncCallback(ReceiveCallback), null);
      }
    } catch (Exception ex) {

      Print("Error in ReceiveCallback: " + ex.Message);

    }
  }

  private bool ReceiveMessages(int port) {
    try{

      //Change here the IP address
      ip = new System.Net.IPEndPoint(System.Net.IPAddress.Loopback
        , port);

      udpClient = new System.Net.Sockets.UdpClient(ip);

      udpClient.BeginReceive(new AsyncCallback(ReceiveCallback), null);

      begunReceiving = true;
      Print("Listening for messages");
      return true;

    } catch (System.Net.Sockets.SocketException ex) {

      if (ex.SocketErrorCode == System.Net.Sockets.SocketError.AddressAlreadyInUse){
        Print("Socket error: If you changed the C# window code without setting the port to -1, you will need to restart Rhino." + ex.Message + ".");
      }

    } catch (Exception ex){
      Print("Error: " + ex.Message);
    }

    return false;
  }

  private void StopReceiving(){
    try {
      if(udpClient != null){
        udpClient.Client.Shutdown(System.Net.Sockets.SocketShutdown.Both);
        udpClient.Close();
        udpClient = null;
      }
      begunReceiving = false;
      Print("Stopped receiving");
    } catch (Exception ex){
      Print("Error while stopping receiving: " + ex.Message);
    }
  }
# ---------- end udp ----------
series_7 = Series(Start=y, Step=Y, Count=X)
panel_8 = Panel(series_7)
pt_6 = Point(item)
panel_9 = Panel(series_2)
points = PointList(Points=pt_6, Tags=True, Lines=True, Size=Slider(2, range=0..30))
panel_11 = Panel(item_2)
panel_12 = Panel(udp.out)
